# Grasshopper definition 06-Tension-Grab.gh (Grasshopper 1.0.4)

# Ring Design with Tension Grab
# Install Required: None
ring_inner_diameter = Slider(16, range=6..30)
ring_thickness = Slider(1.5, range=1..4)
ring_depth = Slider(4, range=2..10)
gem_vertical_position = Slider(0.7, range=0..1)
select = ValueList({"Not Use Input Gem and Use Num. Slider Below": 0, "Use Input Gem and Dim. Auto-Measuring": 1}, selected="Use Input Gem and Dim. Auto-Measuring")
gem_diameter_slider = Slider(3, range=0..10)
input_gem = Geometry(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)
_1st_material = ValueList({"White Gold": "185, 185, 185", "Rose Gold": "175, 153, 133", "Natural Gold": "196, 182, 141"}, selected="White Gold")

# ----
# 2. Auto-Measuring the Diameter of Input Gem
deconstruct_brep = DeconstructBrep(Brep=input_gem)  # -> Faces, Edges, Vertices
deconstruct = Deconstruct(Point=deconstruct_brep.Vertices)  # -> XComponent, YComponent, ZComponent
sort_list = SortList(Keys=deconstruct.XComponent, ValuesValuesA=deconstruct_brep.Vertices)  # -> Keys, ValuesValuesA
list_item = ListItem(List=sort_list.ValuesValuesA, Index="0", Wrap=True)  # -> Item1, Item
distance = Distance(PointA=list_item.Item1, PointB=list_item.Item)  # -> flatten(Distance)
merge = Merge(Data1=list_item.Item1, Data2=list_item.Item)
average = Average(Input=merge)
data_from_gem_diameter_slider = Number(gem_diameter_slider)
data_from_auto_measured_input_gem_s_dim = Number(distance)
merge_2 = Merge(Data1=data_from_gem_diameter_slider, Data2=data_from_auto_measured_input_gem_s_dim)
list_item_2 = ListItem(List=merge_2, Index=select, Wrap=True)

# ----
# 1. Create a Ring Base
panel = Panel("0")
construct_point = ConstructPoint(XCoordinate=panel, YCoordinate=panel, ZCoordinate=panel)
xz_plane = XZPlane(Origin=construct_point)
division = Division(A=ring_inner_diameter, B="2")
circle = Circle(Plane=xz_plane, Radius=division)
plane = Plane(xz_plane)
rotate = Rotate(Geometry=circle, Angle=degrees("90"), Plane=plane)  # -> Geometry, Transform
multiplication = Multiplication(A=ring_thickness, B=gem_vertical_position)
offset = Offset(Curve=rotate.Geometry, Distance=multiplication, Plane=plane, Corners=1)

# ----
# Use Some Trigonometric Function
panel_2 = Panel("r*asin(x/2/r)")

number = Number(list_item_2)
number_2 = Number(division)
# 3-1. Measure the Length of Arc Based on Gem's Diameter by Using Trigonometric Function
# 3-2. Remove the shattered Arc from the Circle
# 3-3. Give Outer Thickness and Depth to the Circle
length = Length(Curve=offset)
evaluate = Evaluate(Expression=panel_2, x=number, r=number_2)
subtraction = Subtraction(A=length, B=evaluate)
merge_3 = Merge(Data1=evaluate, Data2=subtraction)
# Find Length of <Arc AB> (y), When You Know the Length of <Chord AB> (x)
# 
# Length of <Line AB> / 2 = Length of <Line AM> = Length of <Line BM> = (x) / 2
# Length of <Line AC> = Length of <Line BC> = Radius of Circle (r)
# Diameter of Circle = 2 * (r)
# Circumference = 2 * (r) * π
# Angle Between <Line AC> and <Line CM> (θ) = arcsin(Length of <Line AM> / Length of <Line AC>) = arcsin(((x) / 2) / (r))
# 
# ∴ Angle of <Arc AB> = 2 * (θ) = 2 * arcsin(((x) / 2) / (r))
# ∴ Length of <Arc AB> (y) = Circumference *  Angle of <Arc AB> / (2 * π)
# 
#      (y) = 2 * (r) * arcsin(((x) / 2) / (r))
boolean_toggle = BooleanToggle(False)
evaluate_length = EvaluateLength(Curve=offset, Length=flatten(merge_3), Normalized=boolean_toggle)  # -> Point, Tangent, Parameter
shatter = Shatter(Curve=offset, Parameters=evaluate_length.Parameter)
length_2 = Length(Curve=shatter)
sort_list_2 = SortList(Keys=length_2, ValuesValuesA=shatter)  # -> Keys, ValuesValuesA
reverse_list = ReverseList(List=sort_list_2.ValuesValuesA)
number_3 = Number(ring_thickness)
number_4 = Number(multiplication)
negative = Negative(Value=number_4)
list_item_3 = ListItem(List=reverse_list, Index="0", Wrap=True)
subtraction_2 = Subtraction(A=number_3, B=number_4)
offset_2 = Offset(Curve=list_item_3, Distance=negative, Plane=plane, Corners=1)
offset_3 = Offset(Curve=list_item_3, Distance=subtraction_2, Plane=plane, Corners=1)
flip_curve = FlipCurve(Curve=offset_3)  # -> Curve, Flag
merge_4 = Merge(Data1=flatten(offset_2), Data2=flatten(flip_curve.Curve))
number_5 = Number(ring_depth)
connect_curves = ConnectCurves(Curves=merge_4, Continuity=0, Close=True, Bulge=1)
unit_y = UnitY(Factor=1)
division_2 = Division(A=number_5, B="2")
boundary_surfaces = BoundarySurfaces(Edges=connect_curves)
amplitude = Amplitude(Vector=unit_y, Amplitude=division_2)
negative_2 = Negative(Value=number_5)
vector = Vector(unit_y)
move = Move(Geometry=boundary_surfaces, Motion=amplitude)  # -> Geometry, Transform
amplitude_2 = Amplitude(Vector=vector, Amplitude=negative_2)
extrude = Extrude(Base=move.Geometry, Direction=amplitude_2)

# ----
# 4.Orient Gem to the Designated Position
panel_3 = Panel("-1")
list_item_4 = ListItem(List=reverse_list, Index=panel_3, Wrap=True)
explode = Explode(Curve=list_item_4, Recursive=True)  # -> Segments, Vertices
deconstruct_2 = Deconstruct(Point=explode.Vertices)  # -> XComponent, YComponent, ZComponent
sort_list_3 = SortList(Keys=deconstruct_2.XComponent, ValuesValuesA=explode.Vertices)  # -> Keys, ValuesValuesA
list_item_5 = ListItem(List=sort_list_3.ValuesValuesA, Index="0", Wrap=True)  # -> Item1, Item
merge_5 = Merge(Data1=list_item_5.Item1, Data2=list_item_5.Item)
average_2 = Average(Input=merge_5)
point = Point(average)
xy_plane = XYPlane(Origin=point)
xy_plane_2 = XYPlane(Origin=average_2)
orient = Orient(Geometry=input_gem, Source=xy_plane, Target=xy_plane_2)  # -> Geometry, Transform

# ----
# 5. Preview the Final Result
custom_preview = CustomPreview(Geometry=extrude, Material=_1st_material)
custom_preview_2 = CustomPreview(Geometry=orient.Geometry, Material=ColourSwatch(SwatchColor=RGBA(135, 250, 250, 113)))
