# Grasshopper definition R1.gh (Grasshopper 1.0.7)
# plug-ins: Triceratops, Swiftlet

number_slider = Slider(9, range=0..10)

# ---- group: RH_IN:Girth
number = Slider(6, range=0..10)

# ----
xz = XZPlane(Origin=Point(0, 0, 0))
range = Range(Domain="360", Steps=number_slider)
cir = Circle(Plane=xz, Radius=Slider(10, range=0..10))
cull_i = CullIndex(List=range, Indices="-1", Wrap=True)

# ---- group: RH_IN:Twist intensity
number_slider_2 = Slider(5, range=0..10)

# ---- group: RH_IN:Ring type
number_slider_3 = Slider(4, range=0..10)

# ----
pframes = PerpFrames(Curve=cir, Count=number_slider, Align=True)  # -> Frames, Parameters
rad = Radians(Degrees=cull_i)
multiplication = Multiplication(A=rad, B=number)
rotate = Rotate(Geometry=pframes.Frames, Angle=multiplication, Plane=pframes.Frames)  # -> Geometry, Transform
pt = Point(<point referenced from the Rhino model>)
polygon = Polygon(Plane=rotate.Geometry, Radius=number_slider_2, Segments=number_slider_3, FilletRadius=Slider(0.9, range=0..1))  # -> Polygon, Length
panel = Panel("{0,0,1}")
area = Area(Geometry=polygon.Polygon)  # -> Area, Centroid
pull = PullPoint(Point=area.Centroid, Geometry=Point(0, 0, 1), ClosestOnly=True)  # -> ClosestPoint, Distance
dom = ConstructDomain(DomainStart=Slider(1, range=0..1), DomainEnd=Slider(0.2, range=0..1))
bnd = Bounds(Numbers=pull.Distance)

# ---- group: RH_IN:No Twist
toggle = BooleanToggle(False)

# ---- group: RH_IN:Double ring
toggle_2 = BooleanToggle(True)

# ---- group: RH_IN:Smooth edges
toggle_3 = BooleanToggle(False)

# ----
remap = RemapNumbers(Value=pull.Distance, Source=bnd, Target=dom)  # -> Mapped, Clipped
scale = Scale(Geometry=polygon.Polygon, Center=area.Centroid, Factor=remap.Mapped)  # -> Geometry, Transform
loft_opt = LoftOptions(Closed=toggle_2, Adjust=toggle_3, Rebuild=toggle, Refit=Toggle(False), Type=Toggle(True))
loft = Loft(Curves=scale.Geometry, Options=loft_opt)
preview = CustomPreview(
    Geometry=loft,
    Material={diffuse=RGB(221, 160, 221), emission=RGB(66, 48, 66), shine=0.5, specular=RGB(255, 255, 255), transparency=0})
cap = CapHoles(Brep=loft)
mesh = MeshBrep(
    Brep=cap,
    Settings={GridMaxCount=0, GridMinCount=16, JaggedSeams=False, MaxEdgeLength=0, MinEdgeLength=0.0001, MinTolerance=0, Refine=True, RefineAngle=0, RelativeTolerance=0.65, SimplePlanes=True, Tolerance=0})
panel_2 = Panel(mesh)

# ----
# Construct JSON
# JObjects can be constructed from
# a list of any type of JToken and
# a corresponding list of keys
# It is possible to add keys to an
# existing JObject
# It is also possible to remove a key
# from a JObject
toggle_4 = BooleanToggle(True)
values = Panel("""value 1
value 2
value 3
value 4
value 5""")
time = Time(637750800000000000)
values_2 = Panel("""value 1
value 2
value 3
value 4
value 5""")
int = Integer(10)
num = Number(5.89)
merge = Merge(Data1="hello", Data2=int, Data3=num, Data4=time, Data5=toggle_4)
int_2 = Integer("10")
cjv = CreateJSONValue(Value=values_2)
cjv_2 = CreateJSONValue(Value=Toggle(False))
cjv_3 = CreateJSONValue(Value=int_2)
cjv_4 = CreateJSONValue(Value=merge)
cjv_5 = CreateJSONValue(Value=values)
cja = CreateJSONArray(JTokens=cjv_5)
cja_2 = CreateJSONArray(JTokens=cjv)
keys = Panel("""myArray
myValueOne
myValueTwo""")
ja = JArray(cja)
jv = JValue(cjv_4)
merge_2 = Merge(Data1=cja_2, Data2=cjv_2, Data3=cjv_3)
json_values = Panel(jv)
json_array = Panel(ja)
cjo = CreateJSONObject(Keys=keys, Values=merge_2)
jo = JObject(cjo)
json_object = Panel(jo)
sjt = StringifyJSONToken(JToken=jv)
sjt_2 = StringifyJSONToken(JToken=ja)
sjt_3 = StringifyJSONToken(JToken=jo)
cjv_6 = CreateJSONValue(Value="hello")
sjk = SetJSONKey(JObject=jo, Key="myValueThree", JToken=cjv_6)
json = Panel(sjt)
json_2 = Panel(sjt_2)
json_3 = Panel(sjt_3)
sjt_4 = StringifyJSONToken(JToken=sjk)
rjk = RemoveJSONKey(JObject=sjk, Key="myArray")
json_4 = Panel(sjt_4)
sjt_5 = StringifyJSONToken(JToken=rjk)
json_5 = Panel(sjt_5)

demesh = DeconstructMesh(Mesh=mesh)  # -> Vertices, Faces, Colours, Normals
conmesh = ConstructMesh(Vertices=demesh.Vertices, Faces=demesh.Faces)
values_3 = Panel("""value 1
value 2
value 3
value 4
value 5""")
panel_3 = Panel(conmesh)
cjv_7 = CreateJSONValue(Value=toggle_3)
cjv_8 = CreateJSONValue(Value=toggle)
cjv_9 = CreateJSONValue(Value=values_3)
cjv_10 = CreateJSONValue(Value=toggle_2)
mesh_2 = Mesh(Mesh=conmesh, DecimalAccuracy=3)
cja_3 = CreateJSONArray(JTokens=cjv_9)
keys_2 = Panel("""myArray
myValueOne
myValueTwo
my""")

# ---- group: RH_OUT:Ring
serialize = SerializeObject(Object3d=mesh_2, Minify=False, Run=Toggle(True))

# ----
merge_3 = Merge(Data1=cja_3, Data2=cjv_10, Data3=cjv_7, Data4=cjv_8)
cjo_2 = CreateJSONObject(Keys=keys_2, Values=merge_3)
jo_2 = JObject(flatten(cjo_2))
panel_4 = Panel(serialize)
json_object_2 = Panel(jo_2)
