# Grasshopper definition Untitled.gh (Grasshopper 1.0.4)
# plug-ins: MeshEdit Components, Weaverbird

# Ring Design with Voronoi Pattern (Cell Subdivision)
# Install Required: Weaverbird
ring_diameter = Slider(16, range=4..30)
voronoi_making_no_seam_level = Slider(18, range=0..20)
voronoi_cell_for_tessellation_number = Slider(6, range=0..15)
small_cell_tolerance = Slider(3, range=0..4)
big_cell_tolerance = Slider(0.2, range=0..4)
tessellation_factor_smaller_number_more = Slider(0.9, range=0..10)  # "Tessellation Factor (Smaller Number, More Subsrf)"
_1st_material = ValueList({"White Gold": "185, 185, 185", "Rose Gold": "175, 153, 133", "Natural Gold": "196, 182, 141"}, selected="White Gold")
voronoi_factor_smaller_number_more_jitte = Slider(0.5, range=0..1)  # "Voronoi Factor (Smaller Number -> More Jittered)"
voronoi_seed = Slider(19, range=0..100)
voronoi_number = Slider(200, range=0..1000)
voronoi_big_cell_number = Slider(7, range=0..10)
voronoi_big_cell_size_bigger_number_larg = Slider(10, range=0..30)  # "Voronoi Big Cell Size (Bigger Number, Larger Size)"
voronoi_hole_scale = Slider(0.75, range=0..1)
smooth_level = Slider(3, range=0..3)
surface_thickness = Slider(0.4, range=0..1)

# ----
# 1. Create a Ring Base (Sweep Rail)
xz = XZPlane(Origin=Point(0, 0, 0))
pt = ConstructPoint(XCoordinate="0", YCoordinate="0", ZCoordinate="0")
pl_origin = PlaneOrigin(Base=xz, Origin=pt)
division = Division(A=ring_diameter, B="2")
cir = Circle(Plane=pl_origin, Radius=division)
rotate = Rotate(Geometry=cir, Angle=degrees("90"), Plane=xz)  # -> Geometry, Transform
divide = DivideCurve(Curve=rotate.Geometry, Count="2", Kinks=False)  # -> Points, Tangents, Parameters
shatter = Shatter(Curve=rotate.Geometry, Parameters=divide.Parameters)
item = ListItem(List=shatter, Index="1", Wrap=True)
divide_2 = DivideCurve(Curve=item, Count="8", Kinks=False)  # -> Points, Tangents, Parameters
vec2pt = Vector2Pt(PointA=divide_2.Points, PointB=pt, Unitize=False)  # -> Vector, Length
Y = UnitY(Factor=1)
pl = ConstructPlane(Origin=divide_2.Points, XAxis=vec2pt.Vector, YAxis=Y)
dom = ConstructDomain(DomainStart="0", DomainEnd="1")
subtraction = Subtraction(A="8", B="1")
cir_2 = Circle(Plane=pl, Radius="1.5")
range = Range(Domain=dom, Steps=subtraction)
graph = GraphMapper(
    range,
    x0=0,
    x1=1,
    y0=0.3,
    y1=3,
    container_name="Bezier",
    cpx=[0, 0.4977390468, 0.4130434692, 1],
    cpy=[0.4834782481, 0.4230030179, 1, 1])
graph_2 = GraphMapper(
    range,
    x0=0,
    x1=1,
    y0=0.3,
    y1=3,
    container_name="Bezier",
    cpx=[0, 0.5159425735, 0.4115945697, 1],
    cpy=[0.09275352955, 0.09855055809, 0.30144912, 0.3420290947])
scale_nu = ScaleNU(Geometry=cir_2, Plane=pl, ScaleX=graph_2, ScaleY=graph, ScaleZ="1")  # -> Geometry, Transform
merge = Merge(Data1="0", Data2="-1")
yz = YZPlane(Origin=Point(0, 0, 0))
pl_origin_2 = PlaneOrigin(Base=yz, Origin=pt)
cull_i = CullIndex(List=scale_nu.Geometry, Indices=merge, Wrap=True)
mirror = Mirror(Geometry=cull_i, Plane=pl_origin_2)  # -> Geometry, Transform
rev = ReverseList(List=mirror.Geometry)
flatten = FlattenTree(Tree=scale_nu.Geometry, Path="{0}")
flatten_2 = FlattenTree(Tree=rev, Path="{0}")
merge_2 = Merge(Data1=flatten, Data2=flatten_2)
loft_opt = LoftOptions(Closed=True, Adjust=False, Rebuild=0, Refit=0, Type=0)
loft = Loft(Curves=merge_2, Options=loft_opt)

# ----
# 2-1. Create a Flatten Plane Based on Premeasured UV Size
# 2-2. Rectangular Array Base Points to Create Voronoi Cells and Choose Some of Them
xy = XYPlane(Origin=Point(0, 0, 0))
srf = Surface(loft)
pl_origin_3 = PlaneOrigin(Base=xy, Origin=pt)
dim = Dimensions(Surface=srf)  # -> UDimension, VDimension
planesrf = PlaneSurface(Plane=pl_origin_3, XSize=dim.UDimension, YSize=dim.VDimension)
division_2 = Division(A=dim.UDimension, B=voronoi_factor_smaller_number_more_jitte)
division_3 = Division(A=dim.VDimension, B=voronoi_factor_smaller_number_more_jitte)
sdivide = DivideSurface(Surface=planesrf, UCount=division_2, VCount=division_3)  # -> Points, Normals, Parameters
flatten_3 = FlattenTree(Tree=sdivide.Points, Path="{0}")
lng = ListLength(List=flatten_3)
jitter = Jitter(List=flatten_3, Jitter=1, Seed=voronoi_seed)  # -> Values, Indices
subtraction_2 = Subtraction(A=lng, B=voronoi_number)
reduce = RandomReduce(List=jitter.Values, Reduction=subtraction_2, Seed=1)

# ----
# 3. Duplicate and Remove Some Points to Make Seamless Pattern
pt_2 = Point(reduce)
pdecon = Deconstruct(Point=pt_2)  # -> XComponent, YComponent, ZComponent
sort = SortList(Keys=pdecon.XComponent, ValuesA=pt_2)  # -> Keys, ValuesA
graft = GraftTree(Tree=sort.ValuesA, IncludeEmptyLists=True, IncludeNullItems=True)
eval = Evaluate(F="round(x, 3)", x=sort.Keys)
cset = CreateSet(List=eval)  # -> Set, Map
viewer = ParamViewer(graft)
replace = ReplacePaths(Data=graft, Search=viewer, Replace=cset.Map)
pdecon_2 = Deconstruct(Point=replace)  # -> XComponent, YComponent, ZComponent
sort_2 = SortList(Keys=pdecon_2.YComponent, ValuesA=replace)  # -> Keys, ValuesA
group = Group(Objects=sort_2.ValuesA)
yz_2 = YZPlane(Origin=Point(0, 0, 0))
area = Area(Geometry=planesrf)  # -> Area, Centroid
pl_origin_4 = PlaneOrigin(Base=yz_2, Origin=area.Centroid)
flatten_4 = FlattenTree(Tree=group, Path="{0}")
series = Series(Start="0", Step="1", Count=voronoi_making_no_seam_level)
item_2 = ListItem(List=flatten_4, Index=series, Wrap=True)
lng_2 = ListLength(List=flatten_4)
mirror_2 = Mirror(Geometry=item_2, Plane=pl_origin_4)  # -> Geometry, Transform
subtraction_3 = Subtraction(A=lng_2, B=voronoi_making_no_seam_level)
replace_2 = ReplaceItems(List=flatten_4, Item=mirror_2.Geometry, Indices=subtraction_3, Wrap=False)
ungroup = Ungroup(Group=replace_2)
flatten_5 = FlattenTree(Tree=ungroup, Path="{0}")
pdecon_3 = Deconstruct(Point=flatten_5)  # -> XComponent, YComponent, ZComponent
sort_3 = SortList(Keys=pdecon_3.YComponent, ValuesA=flatten_5)  # -> Keys, ValuesA
graft_2 = GraftTree(Tree=sort_3.ValuesA, IncludeEmptyLists=True, IncludeNullItems=True)
eval_2 = Evaluate(F="round(x, 3)", x=sort_3.Keys)
cset_2 = CreateSet(List=eval_2)  # -> Set, Map
viewer_2 = ParamViewer(graft_2)
replace_3 = ReplacePaths(Data=graft_2, Search=viewer_2, Replace=cset_2.Map)
pdecon_4 = Deconstruct(Point=replace_3)  # -> XComponent, YComponent, ZComponent
sort_4 = SortList(Keys=pdecon_4.XComponent, ValuesA=replace_3)  # -> Keys, ValuesA
group_2 = Group(Objects=sort_4.ValuesA)
xz_2 = XZPlane(Origin=Point(0, 0, 0))
area_2 = Area(Geometry=planesrf)  # -> Area, Centroid
pl_origin_5 = PlaneOrigin(Base=xz_2, Origin=area_2.Centroid)
flatten_6 = FlattenTree(Tree=group_2, Path="{0}")
series_2 = Series(Start="0", Step="1", Count=voronoi_making_no_seam_level)
item_3 = ListItem(List=flatten_6, Index=series_2, Wrap=True)
lng_3 = ListLength(List=flatten_6)
mirror_3 = Mirror(Geometry=item_3, Plane=pl_origin_5)  # -> Geometry, Transform
subtraction_4 = Subtraction(A=lng_3, B=voronoi_making_no_seam_level)
replace_4 = ReplaceItems(List=flatten_6, Item=mirror_3.Geometry, Indices=subtraction_4, Wrap=False)
ungroup_2 = Ungroup(Group=replace_4)
flatten_7 = FlattenTree(Tree=ungroup_2, Path="{0}")
srf_2 = Surface(planesrf)
cullpt = CullDuplicates(Points=flatten_7, Tolerance=small_cell_tolerance, CullMode=3)  # -> Points, Indices, Valence
voronoi = Voronoi(Points=cullpt.Points, Boundary=srf_2, BruteForceOverride=False)
edges = BrepEdges(Brep=srf_2)  # -> Naked, Interior, NonManifold
edges_2 = BrepEdges(Brep=srf_2)  # -> Naked, Interior, NonManifold
len = Length(Curve=edges_2.Naked)
sort_5 = SortList(Keys=len, ValuesA=edges_2.Naked)  # -> Keys, ValuesA
rev_2 = ReverseList(List=sort_5.ValuesA)
item_4 = ListItem(List=rev_2, Index="0", Wrap=True)  # -> Item, Item1
flip = FlipCurve(Curve=item_4.Item1)  # -> Curve, Flag
tweencrv = TweenCurve(CurveA=item_4.Item, CurveB=flip.Curve, Factor=0.5, BlendType=0)
ccx = CurveCurve(CurveA=voronoi, CurveB=tweencrv)  # -> Points, ParamsA, ParamsB
lng_4 = ListLength(List=ccx.Points)
flatten_8 = FlattenTree(Tree=lng_4, Path="{0}")
equals = Equality(FirstNumber=flatten_8, SecondNumber="0")  # -> Equality, Inequality
cull = CullPattern(List=voronoi, CullPattern=equals.Inequality)
cull_2 = CullPattern(List=cullpt.Points, CullPattern=equals.Equality)
cull_3 = CullPattern(List=cullpt.Points, CullPattern=equals.Inequality)

# ----
# 4-1. Subdivide Selected Cells to Add Small Voronoi Pattern
# 4-2. Create Voronoi Cells
area_3 = Area(Geometry=srf_2)  # -> Area, Centroid
dist = Distance(PointA=cull_3, PointB=area_3.Centroid)
flatten_9 = FlattenTree(Tree=dist, Path="{0}")
flatten_10 = FlattenTree(Tree=cull_3, Path="{0}")
lng_5 = ListLength(List=flatten_10)
num = Number(flatten_9)
bnd = Bounds(Numbers=num)
random = Random(Range=Domain(0, 1), Number=lng_5, Seed="0")
remap = RemapNumbers(Value=num, Source=bnd, Target=Slider(1.16, range=0..3))  # -> Mapped, Clipped
smaller = SmallerThan(FirstNumber=remap.Mapped, SecondNumber=random)  # -> SmallerThan, OrEqualTo
larger = LargerThan(FirstNumber=remap.Mapped, SecondNumber=random)  # -> LargerThan, OrEqualTo
flatten_11 = FlattenTree(Tree=smaller.SmallerThan, Path="{0}")
flatten_12 = FlattenTree(Tree=larger.LargerThan, Path="{0}")
cull_4 = CullPattern(List=cull, CullPattern=flatten_11)
cull_5 = CullPattern(List=cull_3, CullPattern=flatten_11)
cull_6 = CullPattern(List=cull_3, CullPattern=flatten_12)
merge_3 = Merge(Data1=Toggle(True), Data2=Toggle(False))
pdecon_5 = Deconstruct(Point=cull_5)  # -> XComponent, YComponent, ZComponent
rev_3 = ReverseList(List=merge_3)
sort_6 = SortList(Keys=pdecon_5.XComponent, ValuesA=cull_4)  # -> Keys, ValuesA
sort_7 = SortList(Keys=pdecon_5.XComponent, ValuesA=cull_5)  # -> Keys, ValuesA
cull_7 = CullPattern(List=sort_7.ValuesA, CullPattern=rev_3)
cull_8 = CullPattern(List=sort_6.ValuesA, CullPattern=merge_3)
merge_4 = Merge(Data1=cull_6, Data2=cull_7, Data3=cull_2)
flatten_13 = FlattenTree(Tree=merge_4, Path="{0}")
area_4 = Area(Geometry=cull_8)  # -> Area, Centroid
boundary = BoundarySurfaces(Edges=cull_8)
division_4 = Division(A=area_4.Area, B=tessellation_factor_smaller_number_more)
popgeo = PopulateGeometry(Geometry=boundary, Count=division_4, Seed=1)
merge_5 = Merge(Data1=flatten_13, Data2=popgeo)
flatten_14 = FlattenTree(Tree=merge_5, Path="{0}")
cullpt_2 = CullDuplicates(Points=flatten_14, Tolerance=big_cell_tolerance, CullMode=3)  # -> Points, Indices, Valence
voronoi_2 = Voronoi(Points=cullpt_2.Points, Boundary=srf_2, BruteForceOverride=False)

# ----
# 4-1. Morph the Flatten Pattern to the Target Surface (Ring Base)
# 4-2. Create a Hole in Each Voronoi Cell
Z = UnitZ(Factor=1)
amp = Amplitude(Vector=Z, Amplitude="1")
extr = Extrude(Base=srf_2, Direction=amp)
srf_3 = Surface(reparameterize(srf))
crv = Curve(voronoi_2)
srfmorph = SurfaceMorph(Geometry=crv, Reference=extr, Surface=srf_3, UDomain="1", VDomain="1", WDomain="0.001")
pcen = PolygonCenter(Polyline=srfmorph)  # -> CenterV, CenterE, CenterA
scale = Scale(Geometry=srfmorph, Center=pcen.CenterV, Factor=voronoi_hole_scale)  # -> Geometry, Transform
explode = Explode(Curve=scale.Geometry, Recursive=True)  # -> Segments, Vertices
explode_2 = Explode(Curve=srfmorph, Recursive=True)  # -> Segments, Vertices
graft_3 = GraftTree(Tree=explode.Segments, IncludeEmptyLists=True, IncludeNullItems=True)
graft_4 = GraftTree(Tree=explode_2.Segments, IncludeEmptyLists=True, IncludeNullItems=True)
end = EndPoints(Curve=graft_3)  # -> Start, End
end_2 = EndPoints(Curve=graft_4)  # -> Start, End
merge_6 = Merge(Data1=end.Start, Data2=end.End, Data3=end_2.End, Data4=end_2.Start)
quad = MeshQuad(CornerA=0, CornerB=1, CornerC=2, CornerD=3)
mesh = Mesh(Vertices=merge_6, Faces=quad)

# ----
# 6. Create an Algorithm to Detect Error in Making Seamless Pattern
curvepoint = PointOnCurve(edges.Naked, parameter=0.5)
pdecon_6 = Deconstruct(Point=curvepoint)  # -> XComponent, YComponent, ZComponent
explode_3 = Explode(Curve=crv, Recursive=True)  # -> Segments, Vertices
sort_8 = SortList(Keys=pdecon_6.YComponent, ValuesA=edges.Naked)  # -> Keys, ValuesA
flatten_15 = FlattenTree(Tree=explode_3.Segments, Path="{0}")
item_5 = ListItem(List=sort_8.ValuesA, Index="0", Wrap=True)  # -> Item, Item1, Item2, Item3
merge_7 = Merge(Data1=item_5.Item, Data2=item_5.Item3)
merge_8 = Merge(Data1=item_5.Item1, Data2=item_5.Item2)
curvepoint_2 = PointOnCurve(flatten_15, parameter=0.5)
graft_5 = GraftTree(Tree=merge_7, IncludeEmptyLists=True, IncludeNullItems=True)
graft_6 = GraftTree(Tree=merge_8, IncludeEmptyLists=True, IncludeNullItems=True)
crv_cp = CurveClosestPoint(Point=curvepoint_2, Curve=graft_5)  # -> Point, Parameter, Distance
crv_cp_2 = CurveClosestPoint(Point=curvepoint_2, Curve=graft_6)  # -> Point, Parameter, Distance
simplify = SimplifyTree(Tree=crv_cp.Distance, Front=False)
simplify_2 = SimplifyTree(Tree=crv_cp_2.Distance, Front=False)
flip_2 = FlipMatrix(Data=simplify)
flip_3 = FlipMatrix(Data=simplify_2)
sort_9 = SortList(Keys=flip_2, ValuesA=flip_2)  # -> Keys, ValuesA
sort_10 = SortList(Keys=flip_3, ValuesA=flip_3)  # -> Keys, ValuesA
item_6 = ListItem(List=sort_9.ValuesA, Index="0", Wrap=True)
item_7 = ListItem(List=sort_10.ValuesA, Index="0", Wrap=True)
eval_3 = Evaluate(F="round(x, 2)", x=item_6)
eval_4 = Evaluate(F="round(x, 2)", x=item_7)
flatten_16 = FlattenTree(Tree=eval_3, Path="{0}")
flatten_17 = FlattenTree(Tree=eval_4, Path="{0}")
dispatch = Dispatch(List=flatten_15, DispatchPattern=flatten_16)  # -> ListA, ListB
dispatch_2 = Dispatch(List=flatten_15, DispatchPattern=flatten_17)  # -> ListA, ListB
crv_2 = Curve(dispatch.ListB)
crv_3 = Curve(dispatch_2.ListB)
join = JoinCurves(Curves=crv_2, Preserve=False)
join_2 = JoinCurves(Curves=crv_3, Preserve=False)
item_8 = ListItem(List=join, Index=0, Wrap=True)  # -> Item, Item1
item_9 = ListItem(List=join_2, Index=0, Wrap=True)  # -> Item, Item1
flip_4 = FlipCurve(Curve=item_8.Item1)  # -> Curve, Flag
flip_5 = FlipCurve(Curve=item_9.Item1)  # -> Curve, Flag
merge_9 = Merge(Data1=item_8.Item, Data2=flip_4.Curve)
merge_10 = Merge(Data1=item_9.Item, Data2=flip_5.Curve)
explode_4 = Explode(Curve=merge_9, Recursive=True)  # -> Segments, Vertices
explode_5 = Explode(Curve=merge_10, Recursive=True)  # -> Segments, Vertices
len_2 = Length(Curve=explode_4.Segments)
len_3 = Length(Curve=explode_5.Segments)
flip_6 = FlipMatrix(Data=len_2)
flip_7 = FlipMatrix(Data=len_3)
eval_5 = Evaluate(F="round(x, 2)", x=flip_6)
eval_6 = Evaluate(F="round(x, 2)", x=flip_7)
item_10 = ListItem(List=eval_5, Index=0, Wrap=True)  # -> Item, Item1
item_11 = ListItem(List=eval_6, Index=0, Wrap=True)  # -> Item, Item1
subtraction_5 = Subtraction(A=item_10.Item, B=item_10.Item1)
subtraction_6 = Subtraction(A=item_11.Item, B=item_11.Item1)
flatten_18 = FlattenTree(Tree=subtraction_5, Path="{0}")
flatten_19 = FlattenTree(Tree=subtraction_6, Path="{0}")
ma = MassAddition(Input=flatten_18)  # -> Result, PartialResults
ma_2 = MassAddition(Input=flatten_19)  # -> Result, PartialResults
merge_11 = Merge(Data1=ma.Result, Data2=ma_2.Result)
eval_7 = Evaluate(F="if(x=0, \"(0,0,255)\", \"(255,0,0)\")", x=merge_11)

# ----
# **CONFIRM**
# All Boxs Shoud Be
# Colored "Blue"
# (Unless, Raise Number in <No Seam Level> Slider)
legend = Legend(Colour=eval_7, Tags=["Vertical Line", "Horizontal Line"], LegendType=1)

# ----
# 5-1. Join All Mesh and Give Outer Thickness to the Mesh
# 5-2. Transform the Shape with Weaverbird Catmull-Clark Subdivision
# 5-3. Preview the Final Result
pshift = ShiftPaths(Data=mesh, Offset=-1)
mjoin = MeshJoin(Meshes=pshift)
weldvertices = MeshWeldVertices(Mesh=mjoin, Tolerance="0.0001")  # -> RuntimeMessage, Mesh
flatten_20 = FlattenTree(Tree=weldvertices.Mesh, Path="{0}")
mjoin_2 = MeshJoin(Meshes=flatten_20)
weldvertices_2 = MeshWeldVertices(Mesh=mjoin_2, Tolerance="0.0001")  # -> RuntimeMessage, Mesh
unifynormals = MeshUnifyNormals(Mesh=weldvertices_2.Mesh)
wbthicken = WeaverBirdsMeshThicken(Mesh=unifynormals, Distance=surface_thickness, OffsetType=0)
wbcatmullclark = WeaverbirdsCatmullClarkSubdivision(MeshCurves=wbthicken, Level=smooth_level, SmoothNakedEdges=1)
preview = CustomPreview(Geometry=wbcatmullclark, Shader=_1st_material)
