# Grasshopper definition Ear ring.gh (Grasshopper 1.0.7)

number_slider = Slider(7, range=5..30)
number_slider_2 = Slider(7.37, range=0..20)
radius = GetNumber(Slider(6.4, range=0..20), AtLeast=1, AtMost=1, Maximum=1.797693135e+308, Minimum=-1.797693135e+308)
construct_point = ConstructPoint(XCoordinate=0, YCoordinate=0, ZCoordinate=number_slider_2)
construct_point_2 = ConstructPoint(XCoordinate=expr("-x", number_slider), YCoordinate=0, ZCoordinate=0)
construct_point_3 = ConstructPoint(XCoordinate=0, YCoordinate=radius, ZCoordinate=0)
construct_point_4 = ConstructPoint(XCoordinate=number_slider, YCoordinate=0, ZCoordinate=0)
construct_point_5 = ConstructPoint(XCoordinate=0, YCoordinate=0, ZCoordinate=number_slider_2)
construct_point_6 = ConstructPoint(XCoordinate=expr("-x", number_slider), YCoordinate=0, ZCoordinate=0)
construct_point_7 = ConstructPoint(XCoordinate=number_slider, YCoordinate=0, ZCoordinate=0)
construct_point_8 = ConstructPoint(XCoordinate=0, YCoordinate=radius, ZCoordinate=0)
count = GetNumber(Slider(11, range=0..11), AtLeast=1, AtMost=1, Maximum=1.797693135e+308, Minimum=-1.797693135e+308)
interpolate = Interpolate(Vertices=[construct_point_4, construct_point_3, construct_point_2], Degree=3, Periodic=False, KnotStyle=1)  # -> Curve, Length, Domain
xz_plane = XZPlane(Origin=Point(0, 0, 0))
interpolate_2 = Interpolate(Vertices=[construct_point_7, construct_point_8, construct_point_6], Degree=3, Periodic=False, KnotStyle=1)  # -> Curve, Length, Domain
xz_plane_2 = XZPlane(Origin=Point(0, 0, 0))
mirror = Mirror(Geometry=interpolate.Curve, Plane=xz_plane)  # -> Geometry, Transform
mirror_2 = Mirror(Geometry=interpolate_2.Curve, Plane=xz_plane_2)  # -> Geometry, Transform
divide_curve = DivideCurve(Curve=interpolate_2.Curve, Count=count, Kinks=False)  # -> Points, Tangents, Parameters
divide_curve_2 = DivideCurve(Curve=mirror.Geometry, Count=count, Kinks=False)  # -> Points, Tangents, Parameters
divide_curve_3 = DivideCurve(Curve=mirror_2.Geometry, Count=count, Kinks=False)  # -> Points, Tangents, Parameters
divide_curve_4 = DivideCurve(Curve=interpolate.Curve, Count=count, Kinks=False)  # -> Points, Tangents, Parameters
join_curves = JoinCurves(Curves=[interpolate_2.Curve, mirror_2.Geometry], Preserve=False)
join_curves_2 = JoinCurves(Curves=[interpolate.Curve, mirror.Geometry], Preserve=False)
number_slider_3 = Slider(0.4, range=0.2..1.5)
line = Line(StartPoint=divide_curve_4.Points, EndPoint=divide_curve_2.Points)
line_2 = Line(StartPoint=divide_curve.Points, EndPoint=divide_curve_3.Points)
surface_split = SurfaceSplit(Surface=join_curves_2, Curves=line)
surface_split_2 = SurfaceSplit(Surface=join_curves, Curves=line_2)
interpolate_3 = Interpolate(Vertices=[construct_point_4, construct_point, construct_point_2], Degree=3, Periodic=False, KnotStyle=1)  # -> Curve, Length, Domain
offset_curve = OffsetCurve(Curve=surface_split, Distance=expr("-x", number_slider_3), Plane=PlaneXY(0, 0, 0), Corners=1)
offset_curve_2 = OffsetCurve(Curve=surface_split_2, Distance=expr("-x", number_slider_3), Plane=PlaneXY(0, 0, 0), Corners=1)
interpolate_4 = Interpolate(Vertices=[construct_point_7, construct_point_5, construct_point_6], Degree=3, Periodic=False, KnotStyle=1)  # -> Curve, Length, Domain
loft = Loft(
    Curves=[interpolate.Curve, interpolate_3.Curve, mirror.Geometry],
    Options={Adjust=False, Closed=False, LoftEnds=0, LoftSimp=0, LoftType=0, Rebuild=10, Refit=0.01})
loft_2 = Loft(
    Curves=[interpolate_2.Curve, interpolate_4.Curve, mirror_2.Geometry],
    Options={Adjust=False, Closed=False, LoftEnds=0, LoftSimp=0, LoftType=0, Rebuild=10, Refit=0.01})

d = Slider(0.05, range=0.05..0.3)
r = Slider(6.06, range=0..100)
xz_plane_3 = XZPlane(Origin=Point(0, 0, 0))
rotate_plane = RotatePlane(Plane=xz_plane_3, Angle=degrees(Slider(100, range=0..100)))
construct_domain = ConstructDomain(DomainStart=d, DomainEnd=expr("1-x", d))
circle = Circle(Plane=rotate_plane, Radius=r)
sub_curve = SubCurve(BaseCurve=reparameterize(circle), Domain=construct_domain)

d_2 = Slider(0.05, range=0.05..0.3)
r_2 = Slider(6.06, range=0..100)
xz_plane_4 = XZPlane(Origin=Point(0, 0, 0))
rotate_plane_2 = RotatePlane(Plane=xz_plane_4, Angle=degrees(Slider(100, range=0..100)))
construct_domain_2 = ConstructDomain(DomainStart=d_2, DomainEnd=expr("1-x", d_2))
circle_2 = Circle(Plane=rotate_plane_2, Radius=r_2)
sub_curve_2 = SubCurve(BaseCurve=reparameterize(circle_2), Domain=construct_domain_2)

project = Project(Curve=offset_curve, Brep=loft, Direction=Vector(0, 0, 1))  # -> flatten(Curve)

point = Point(flatten([Point(2.593349873, -2.240043839, 27.13561536), Point(7.955624942, -3.22508668, 21.62615134), Point(8.385210322, -3.71333492, 14.44866312), Point(0, -4.216640188, 10.0215709)]))
mirror_3 = Mirror(Geometry=point, Plane=PlaneYZ(0, 0, 0))  # -> reverse(Geometry), Transform
cull_index = CullIndex(List=mirror_3.Geometry, Indices=0, Wrap=True)  # -> flatten(List)
interpolate_5 = Interpolate(Vertices=[point, cull_index], Degree=3, Periodic=False, KnotStyle=1)  # -> Curve, Length, Domain

project_2 = Project(Curve=offset_curve_2, Brep=loft_2, Direction=Vector(0, 0, 1))  # -> flatten(Curve)

point_2 = Point(flatten([Point(2.593349873, -2.240043839, 27.13561536), Point(7.955624942, -3.22508668, 21.62615134), Point(8.385210322, -3.71333492, 14.44866312), Point(0, -4.216640188, 10.0215709)]))
mirror_4 = Mirror(Geometry=point_2, Plane=PlaneYZ(0, 0, 0))  # -> reverse(Geometry), Transform
cull_index_2 = CullIndex(List=mirror_4.Geometry, Indices=0, Wrap=True)  # -> flatten(List)
interpolate_6 = Interpolate(Vertices=[point_2, cull_index_2], Degree=3, Periodic=False, KnotStyle=1)  # -> Curve, Length, Domain

surface_split_3 = SurfaceSplit(Surface=loft, Curves=project)
surface_split_4 = SurfaceSplit(Surface=loft_2, Curves=project_2)
line_3 = Line(StartPoint=construct_point_4, EndPoint=construct_point_2)
list_item = ListItem(List=surface_split_3, Index=0, Wrap=True)
line_4 = Line(StartPoint=construct_point_7, EndPoint=construct_point_6)
list_item_2 = ListItem(List=surface_split_4, Index=0, Wrap=True)
flow = Flow(
    Geometry=list_item,
    Base=line_3,
    Target=interpolate_5.Curve,
    ReverseBase=Toggle(True),
    ReverseTarget=Toggle(False),
    Stretch=True,
    Rigid=False)
flow_2 = Flow(
    Geometry=list_item_2,
    Base=line_4,
    Target=interpolate_6.Curve,
    ReverseBase=Toggle(True),
    ReverseTarget=Toggle(False),
    Stretch=True,
    Rigid=False)
pt = Point(<point referenced from the Rhino model>)  # disabled
Y = UnitY(Factor=Slider(75, range=0..100))
xz = XZPlane(Origin=pt)  # disabled
mirror_5 = Mirror(Geometry=flow, Plane=xz)  # -> Geometry, Transform; disabled
move = Move(Geometry=flow_2, Motion=Y)  # -> Geometry, Transform
mesh = MeshBrep(
    Brep=flow,
    Settings={GridMaxCount=0, GridMinCount=16, JaggedSeams=False, MaxEdgeLength=0, MinEdgeLength=0.0001, MinTolerance=0, Refine=True, RefineAngle=0, RelativeTolerance=0.65, SimplePlanes=True, Tolerance=0})
mesh_2 = MeshBrep(
    Brep=move.Geometry,
    Settings={GridMaxCount=0, GridMinCount=16, JaggedSeams=False, MaxEdgeLength=0, MinEdgeLength=0.0001, MinTolerance=0, Refine=True, RefineAngle=0, RelativeTolerance=0.65, SimplePlanes=True, Tolerance=0})

# ---- group: RH_OUT:mesh
mesh_3 = Mesh(mesh)

# ---- group: RH_OUT:right
mesh_4 = Mesh(mesh_2)
