# Grasshopper definition R1.gh (Grasshopper 1.0.7)

number_slider = Slider(9, range=0..10)

# ---- group: RH_IN:Girth
number = Slider(6, range=0..10)

# ----
xz = XZPlane(Origin=Point(0, 0, 0))
range = Range(Domain="360", Steps=number_slider)
cir = Circle(Plane=xz, Radius=Slider(10, range=0..10))
cull_i = CullIndex(List=range, Indices="-1", Wrap=True)

# ---- group: RH_IN:Twist intensity
number_slider_2 = Slider(5, range=0..10)

# ---- group: RH_IN:Ring type
number_slider_3 = Slider(4, range=0..10)

# ----
pframes = PerpFrames(Curve=cir, Count=number_slider, Align=True)  # -> Frames, Parameters
rad = Radians(Degrees=cull_i)
multiplication = Multiplication(A=rad, B=number)
rotate = Rotate(Geometry=pframes.Frames, Angle=multiplication, Plane=pframes.Frames)  # -> Geometry, Transform
pt = Point(<point referenced from the Rhino model>)
polygon = Polygon(Plane=rotate.Geometry, Radius=number_slider_2, Segments=number_slider_3, FilletRadius=Slider(0.9, range=0..1))  # -> Polygon, Length
area = Area(Geometry=polygon.Polygon)  # -> Area, Centroid
pull = PullPoint(Point=area.Centroid, Geometry="{0,0,1}", ClosestOnly=True)  # -> ClosestPoint, Distance

# ---- group: RH_IN:Smooth edges
toggle = BooleanToggle(False)

# ----
bnd = Bounds(Numbers=pull.Distance)
dom = ConstructDomain(DomainStart=Slider(1, range=0..1), DomainEnd=Slider(0.2, range=0..1))

# ---- group: RH_IN:Double ring
toggle_2 = BooleanToggle(True)

# ---- group: RH_IN:No Twist
toggle_3 = BooleanToggle(False)

# ----
remap = RemapNumbers(Value=pull.Distance, Source=bnd, Target=dom)  # -> Mapped, Clipped
scale = Scale(Geometry=polygon.Polygon, Center=area.Centroid, Factor=remap.Mapped)  # -> Geometry, Transform
loft_opt = LoftOptions(Closed=toggle_2, Adjust=toggle, Rebuild=toggle_3, Refit=Toggle(False), Type=Toggle(True))
loft = Loft(Curves=scale.Geometry, Options=loft_opt)
preview = CustomPreview(
    Geometry=loft,
    Material={diffuse=RGB(221, 160, 221), emission=RGB(66, 48, 66), shine=0.5, specular=RGB(255, 255, 255), transparency=0})
cap = CapHoles(Brep=loft)
mesh = MeshBrep(
    Brep=cap,
    Settings={GridMaxCount=0, GridMinCount=16, JaggedSeams=False, MaxEdgeLength=0, MinEdgeLength=0.0001, MinTolerance=0, Refine=True, RefineAngle=0, RelativeTolerance=0.65, SimplePlanes=True, Tolerance=0})
demesh = DeconstructMesh(Mesh=mesh)  # -> Vertices, Faces, Colours, Normals

# ---- group: RH_OUT:Ring
conmesh = ConstructMesh(Vertices=demesh.Vertices, Faces=demesh.Faces)

# ----
panel = Panel(conmesh)
